# Dynamo graph Execute_visualizeSelection.dyn (Dynamo 2.12.0.5650)
# packages: archi-lab.net 2022.210.1022

rerunnodes = Python()  # CPython3; unwired: IN[0]
# ---------- rerunnodes.python (83 lines) ----------
###############################################################
# Import general packages.
import clr
import sys
import math
import System
import io
import os
import importlib

# Import Revit/Dynamo API related packages.
clr.AddReference('DynamoRevitDS')
import Dynamo
from System import Array
from System.Collections.Generic import *
clr.AddReference("RevitNodes")
import Revit
clr.ImportExtensions(Revit.Elements)
clr.ImportExtensions(Revit.GeometryConversion)
clr.AddReference("RevitServices")
import RevitServices
from RevitServices.Persistence import DocumentManager 
from RevitServices.Transactions import TransactionManager 
clr.AddReference("RevitAPI")
clr.AddReference('ProtoGeometry')
import Autodesk 
from Autodesk.DesignScript.Geometry import *
from Autodesk.DesignScript import *
from Autodesk.Revit.DB import *
from Autodesk.Revit.DB import Parameter
from Autodesk.Revit.DB.Architecture import *
from Autodesk.Revit.DB import IFailuresPreprocessor

# Import external python packages.
localapp = os.getenv(r'LOCALAPPDATA')
sys.path.append(os.path.join(localapp, r'python-3.8.3-embed-amd64\Lib\site-packages'))

# Import customized python packgaes.
sys.path.append(r'C:\dev\phd\jw\healing\src\godyn')

import healBasics
importlib.reload(healBasics)
import healChecks
importlib.reload(healChecks)
import healParameters
importlib.reload(healParameters)

###############################################################
doc = DocumentManager.Instance.CurrentDBDocument


###############################################################
# Temporary functions


###############################################################
# Prepare the input (of the Python Node)
element = IN[0]


##############################################################
# Prepare the output (of the Python Node)
out = []


###############################################################
# Start Transaction in Revit
TransactionManager.Instance.EnsureInTransaction(doc)


###############################################################
# Main part
healBasics.rerunNodes()


###############################################################
# End Transaction in Revit
TransactionManager.Instance.TransactionTaskDone()


###############################################################
# End
OUT = out
# ----------------------------------------

# group: Tune the 3D graphics style.
current = Document.Current()  # frozen
activeView = Document.ActiveView(document=current)
setGraphicsStyle = Python(IN[0]=activeView)  # CPython3
# ---------- setGraphicsStyle.python (83 lines) ----------
###############################################################
# Import general packages.
import clr
import sys
import math
import System
import io
import os
import importlib

# Import Revit/Dynamo API related packages.
clr.AddReference('DynamoRevitDS')
import Dynamo
from System import Array
from System.Collections.Generic import *
clr.AddReference("RevitNodes")
import Revit
clr.ImportExtensions(Revit.Elements)
clr.ImportExtensions(Revit.GeometryConversion)
clr.AddReference("RevitServices")
import RevitServices
from RevitServices.Persistence import DocumentManager 
from RevitServices.Transactions import TransactionManager 
clr.AddReference("RevitAPI")
clr.AddReference('ProtoGeometry')
import Autodesk 
from Autodesk.DesignScript.Geometry import *
from Autodesk.DesignScript import *
from Autodesk.Revit.DB import *
from Autodesk.Revit.DB import Parameter
from Autodesk.Revit.DB.Architecture import *
from Autodesk.Revit.DB import IFailuresPreprocessor

# Import external python packages.
localapp = os.getenv(r'LOCALAPPDATA')
sys.path.append(os.path.join(localapp, r'python-3.8.3-embed-amd64\Lib\site-packages'))

# Import customized python packgaes.
sys.path.append(r'C:\dev\phd\jw\healing\src\godyn')

import healBasics
importlib.reload(healBasics)
import healChecks
importlib.reload(healChecks)
import healParameters
importlib.reload(healParameters)
import healVisual
importlib.reload(healVisual)

###############################################################
doc = DocumentManager.Instance.CurrentDBDocument


###############################################################
# Temporary functions


###############################################################
# Prepare the input (of the Python Node)
elements = UnwrapElement(IN[0])

##############################################################
# Prepare the output (of the Python Node)
out = []

###############################################################
# Start Transaction in Revit
TransactionManager.Instance.EnsureInTransaction(doc)


###############################################################
# Main part
out = healVisual.setGraphicsStyle(elements)


###############################################################
# End Transaction in Revit
TransactionManager.Instance.TransactionTaskDone()


###############################################################
# End
OUT = out
# ----------------------------------------

k_search_neighbor = DoubleInput(1)

# group: Locate to the correct directory.
string = StringInput("IBC1020_2")
string_2 = StringInput("IBC1207_1")
string_3 = StringInput("IBC1207_3")
list_create = List.Create(item0=string, item1=string_2, item2=string_3)
string_4 = StringInput("neighbor_")
string_from_object = FromObject(object=k_search_neighbor)
add = string_4 + string_from_object
string_5 = StringInput("C:\dev\phd\ModelHealer\ini\topo\")
add_2 = string_5 + add
string_6 = StringInput("\")
add_3 = add_2 + string_6

# group: Create FloorPlan View according to related neighborhood level.
categories = Categories("OST_Views")
all_elements_of_category = ElementsOfCategory(Category=categories)
boolean = BoolSelector(false)
clean = List.Clean(list=all_elements_of_category, preserveIndices=boolean)
code_block = CodeBlock { "View Name"; }
getParameterValueByName = Element.GetParameterValueByName(element=clean, parameterName=code_block)
contains = String.Contains(string=getParameterValueByName, searchFor=list_create@L1)
filterByBoolMask = List.FilterByBoolMask(list=clean, mask=contains@L2)
code_block_2 = CodeBlock { "View Name"; }
getParameterValueByName_2 = Element.GetParameterValueByName(element=filterByBoolMask.in, parameterName=code_block_2)
string_7 = StringInput("neighbor")
contains_2 = String.Contains(string=getParameterValueByName_2, searchFor=string_7)
filterByBoolMask_2 = List.FilterByBoolMask(list=filterByBoolMask.in@L2, mask=contains_2@L2)
string_8 = StringInput("AsDependent")
string_9 = StringInput("_")
add_4 = string_9 + add
duplicateView = View.DuplicateView(view=filterByBoolMask_2.out@L1, viewDuplicateOption=string_8, suffix=add_4)

# group: Visualize the Checking Failures and the Potential Neighbors.
string_10 = StringInput("res_ini_perrule_failure.csv")
add_5 = add_3 + string_10
string_11 = StringInput("res_ini_perrule_failureelement.csv")
add_6 = add_3 + string_11
string_12 = StringInput("res_ini_perrule_failureelement_constraint.csv")
add_7 = add_3 + string_12
passThrough = Custom[PassThrough](passThrough=add, waitFor=duplicateView)  # package archi-lab.net; Ripped this off from Clockwork. Sorry Andy.
visualizeSelection = Custom[visualizeSelection](CSVPathFailure=add_5, CSVPathFailureElements=add_6, CSVPathFailureElementsConstrained=add_7, neighborLevelString=passThrough, ruleNameString=list_create, lacing=Longest)  # visualize the selected elements.

# group: Export to PNG.
passThrough_2 = Custom[PassThrough](passThrough=duplicateView, waitFor=visualizeSelection)
getParameterValueByName_3 = Element.GetParameterValueByName(element=duplicateView, parameterName=code_block)
string_13 = StringInput(".png")
add_8 = getParameterValueByName_3 + string_13
add_9 = add_3 + add_8
exportAsImage = View.ExportAsImage(view=passThrough_2, path=add_9)
